# Dynamo graph test.dyn (Dynamo 0.8.0.1233)

code_block = CodeBlock { "programData"; }
boolean = BoolSelector(true)
findControllers = Dynamo_toRo.RobComm.findControllers(boolean)
code_block_2 = CodeBlock(vc=findControllers.out1) { vc[0]; }
file_path = Filename("C:\Users\II\Downloads\copyUpdatesHere-master\copyUpdatesHere-master\bin\Debug\test.prg")
code_block_3 = CodeBlock()
# ---------- code_block_3.designscript (8 lines) ----------
vals = -10..10;
DataTypes.RobTargetAtVals(
 300,vals,100,0,0,1,0);
251;
"fine";
"position";
"tool";
"wobj";
# ----------------------------------------
moveJ = Dynamo_toRo.Instructions.MoveJ(code_block_3.out1, code_block_3.out2, code_block_3.out3, code_block_3.out4, code_block_3.out5, code_block_3.out6)
code_block_4 = CodeBlock()
# ---------- code_block_4.designscript (4 lines) ----------
DataTypes.ToolAtVals(
 10,0,0,1,0,0,0,1,"tool");
DataTypes.WobjAtVals(
 0,0,0,1,0,0,0,"wobj");
# ----------------------------------------
createRapid = Dynamo_toRo.WriteProgram.createRapid(file_path, moveJ.out0, moveJ.out1, code_block_4.out0, code_block_4.out1)
sendProgramToController = Dynamo_toRo.RobComm.sendProgramToController(boolean, code_block_2, createRapid)
getExecutionStatus2 = Dynamo_toRo.RobComm.getExecutionStatus2(boolean, code_block_2)
code_block_5 = CodeBlock()
# ---------- code_block_5.designscript (4 lines) ----------
plane = Plane.ByOriginNormal(
 Point.ByCoordinates(0,0,0),
 Vector.ByCoordinates(0,0,1));
Utilities.QuatListAtPlane(plane);
# ----------------------------------------
