# Dynamo graph test2.dyn (Dynamo 0.8.0.1233)

boolean = BoolSelector(true)
findControllers = Dynamo_toRo.RobComm.findControllers(boolean)
code_block = CodeBlock(c=findControllers.out1) { c[0]; }
listenToRobot = Dynamo_toRo.RobComm.listenToRobot(boolean, code_block)
file_path = Filename("C:\Users\II\Downloads\copyUpdatesHere-master\copyUpdatesHere-master\bin\Debug\test.prg")
sendProgramToController = Dynamo_toRo.RobComm.sendProgramToController(boolean, code_block, file_path)
getExecutionStatus2 = Dynamo_toRo.RobComm.getExecutionStatus2(boolean, code_block)
